# Dynamo graph 1_connect_to_db.dyn (Dynamo 2.12.0.5650)

# group: data columns
code_block = CodeBlock { "Id"; "Идентификатор объекта"; }
uuid = DynPgsql.Table.Data_type.Uuid()
data_column = DynPgsql.Table.Data_column.Data_column(name=code_block.out0, type=uuid, comment=code_block.out1)
code_block_2 = CodeBlock { "Color"; "Цвет объекта"; }
string = DynPgsql.Table.Data_type.String()
data_column_2 = DynPgsql.Table.Data_column.Data_column(name=code_block_2.out0, type=string, comment=code_block_2.out1)
list_create = List.Create(item0=data_column, item1=data_column_2)

# group: geometry column
code_block_3 = CodeBlock { "Solids_geometry"; ""; 0; }
polyhedralSurface = DynPgsql.Geometry.Generals_Geometry_type.PolyhedralSurface()
geometry_column = DynPgsql.Geometry.Generals_Geometry_column.Geometry_column(name=code_block_3.out0, type=polyhedralSurface, SRID=code_block_3.out2, comment=code_block_3.out1)

# group: getting table's creation command
code_block_4 = CodeBlock { "solids_geometry"; "Table with Acad solids geometry"; "Polyhedral"; }
table = DynPgsql.Table.Table.Table(t_name=code_block_4.out0, t_comment=code_block_4.out1, columns=list_create, geom=geometry_column, geom_comment=code_block_4.out2)
getCreationCommand = DynPgsql.Table.Table.GetCreationCommand(table=table)

saveQuerry = DynPgsql.Connect.SaveQuerry(row_sql=getCreationCommand)
directory_path = Directory("C:\Program Files\PostgreSQL\14\bin")

# group: connection parameters
code_block_5 = CodeBlock { "localhost"; "5432"; "test_admin"; "test_password_123"; "geom_dyn_db1"; }
setConnectSettings = DynPgsql.Connect.SetConnectSettings(host_name=code_block_5.out0, Port=code_block_5.out1, Username=code_block_5.out2, Password=code_block_5.out3, db_name=code_block_5.out4)

runQuerry = DynPgsql.Connect.RunQuerry(path_to_sql=saveQuerry, path_to_pgsql_dir_bin=directory_path, conn_config=setConnectSettings)
code_block_6 = CodeBlock {  }
